# Grasshopper definition 灰阶识别.gh (Grasshopper 1.0.7)

series = Series(Start=0, Step=1, Count=Slider(150, range=0..1000))  # -> graft(Series)
series_2 = Series(Start=0, Step=1, Count=Slider(195, range=0..1000))
construct_point = ConstructPoint(XCoordinate=series, YCoordinate=series_2, ZCoordinate=0)
image_sampler = ImageSampler(
    construct_point,
    FilePath="C:\Users\QQEQWR\Desktop\u=1731720152,2290006324&fm=26&gp=0.jpg",
    Filter="Value",
    Interpolate=True,
    Umax=150,
    Umin=0,
    Vmax=195,
    Vmin=0,
    Wrap=1)
panel = Panel(construct_point)
minimum = Minimum()
expression = Expression(Variable_x=image_sampler, Expression="1-x")
panel_2 = Panel(image_sampler)
multiplication = Multiplication(A=expression, B=Slider(0.5, range=0..1))
panel_3 = Panel(expression)
maximum = Maximum(A=multiplication, B=Slider(0.14, range=0..1))
multiplication_2 = Multiplication(A=image_sampler, B=Slider(2, range=0..10))
unit_z = UnitZ(Factor=multiplication_2)
move = Move(Geometry=construct_point, Motion=unit_z)  # -> Geometry, Transform
circle = Circle(Plane=move.Geometry, Radius=maximum)
